# Grasshopper definition curvatureLeaflets.gh (Grasshopper 0.9.76)

path = FilePath("\\Mac\Dropbox\wrmorrow-2\HeartValve\NURBS\geometry\input.geo.dat")

free_height_offset = Slider(-0.3, range=-0.5..0.3)
commisure_angle = Slider(0, range=0..15)
fixed_edge_blend = Slider(0.471, range=0.25..1)
centerline_blend = Slider(0, range=0..1)
opening_radius = Slider(0.072, range=0.02..0.2)
bottom_radius = Slider(1.115, range=0.8..2)
corner_height = Slider(1.109, range=0.5..1.5)
interior_blend = Slider(0.82, range=0..1)
sinus_angle = Slider(7, range=0..30)
fixed_angle = Slider(-30, range=-30..80)
top_radius = Slider(1.018, range=0.8..2)
free_angle = Slider(0, range=0..40)
halfleaflet_curves = HalfLeafletCurves(
    bottom_radius=bottom_radius,
    openingradius=opening_radius,
    topradius=top_radius,
    cornerheight=corner_height,
    freeheightoffset=free_height_offset,
    commisureangle=commisure_angle,
    sinusangle=sinus_angle,
    freeangle=free_angle,
    fixedangle=fixed_angle,
    fixededgeblend=fixed_edge_blend,
    centerlineblend=centerline_blend,
    interiorblend=interior_blend)  # -> fixededge_2, centerline_2, freeedge, interior, contact

c_script = CSharpScript(path=path)  # -> out, bRad, oRad, tRad, H, hDelta, cDeg, sDeg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; inputs path: String
# ---------- c_script: C# ----------
    if (!File.Exists(path))
    {
      Print("File doesn't exist");
      return;
    }

    int counter = 0;
    string line;
    List<string> myInts = new List<string>();
    // Read the file and display it line by line.
    StreamReader file = new StreamReader(path);
    while((line = file.ReadLine()) != null)
    {
      Print(line.ToString());
      myInts.Add(line.ToString());
      counter++;
    }

    file.Close();

    bRad = myInts[0];
    oRad = myInts[1];
    tRad = myInts[2];
    H = myInts[3];
    hDelta = myInts[4];

    cDeg = myInts[5];
    sDeg = myInts[6];
    freeDeg = myInts[7];
    fixedDeg = myInts[8];

    fBlend = myInts[9];
    cBlend = myInts[10];
    iBlend = myInts[11];
# ---------- end c_script ----------
pt = ConstructPoint(XCoordinate=1.1152668, YCoordinate=0, ZCoordinate=0)
pt_2 = ConstructPoint(XCoordinate=1.068083882, YCoordinate=0, ZCoordinate=0.005896486342)
pt_3 = ConstructPoint(XCoordinate=0.07197343558, YCoordinate=0, ZCoordinate=0.8403725028)
pt_4 = ConstructPoint(XCoordinate=0.07680869102, YCoordinate=0, ZCoordinate=0.793078661)
panel = Panel(c_script.cDeg)
panel_2 = Panel(c_script.bRad)
panel_3 = Panel(c_script.tRad)
panel_4 = Panel(c_script.hDelta)
panel_5 = Panel(c_script.fixedDeg)
panel_6 = Panel(c_script.iBlend)
panel_7 = Panel(c_script.oRad)
panel_8 = Panel(c_script.H)
panel_9 = Panel(c_script.sDeg)
panel_10 = Panel(c_script.fBlend)
panel_11 = Panel(c_script.cBlend)
panel_12 = Panel(c_script.freeDeg)
pt_5 = ConstructPoint(XCoordinate=0.5120566487, YCoordinate=0.880007863, ZCoordinate=1.109038949)
rad = Radians(Degrees=-60)
pt_6 = ConstructPoint(XCoordinate=0.5170132518, YCoordinate=0.8824037313, ZCoordinate=1.057598591)
rad_2 = Radians(Degrees=-60)
vec2pt = Vector2Pt(PointA=pt, PointB=pt_2, Unitize=False)  # -> Vector, Length
vec2pt_2 = Vector2Pt(PointA=pt_3, PointB=pt_4, Unitize=False)  # -> Vector, Length
X = UnitX(Factor=-1)
Z = UnitZ(Factor=-1)
rot3d = Rotate3D(Geometry=pt_5, Angle=rad, Center=Point(0, 0, 0), Axis=Vector(0, 0, 1))  # -> Geometry, Transform
halfleaflet_curves_2 = HalfLeafletCurves(
    bottom_radius=panel_2,
    openingradius=panel_7,
    topradius=panel_3,
    cornerheight=panel_8,
    freeheightoffset=panel_4,
    commisureangle=panel,
    sinusangle=panel_9,
    freeangle=panel_12,
    fixedangle=panel_5,
    fixededgeblend=panel_10,
    centerlineblend=panel_11,
    interiorblend=panel_6)  # -> fixededge_2, centerline_2, freeedge, interior, contact
rot3d_2 = Rotate3D(Geometry=pt_6, Angle=rad_2, Center=Point(0, 0, 0), Axis=Vector(0, 0, 1))  # -> Geometry, Transform
angle = Angle(VectorA=vec2pt.Vector, VectorB=X)  # -> Angle, Reflex
angle_2 = Angle(VectorA=vec2pt_2.Vector, VectorB=Z)  # -> Angle, Reflex
pdecon = Deconstruct(Point=rot3d.Geometry)  # -> XComponent, YComponent, ZComponent
deg = Degrees(Radians=angle.Angle)
deg_2 = Degrees(Radians=angle_2.Angle)
pdecon_2 = Deconstruct(Point=rot3d_2.Geometry)  # -> XComponent, YComponent, ZComponent
crv = Curve(halfleaflet_curves.fixededge_2)
crv_2 = Curve(halfleaflet_curves.centerline_2)
crv_3 = Curve(halfleaflet_curves.interior)
crv_4 = Curve(halfleaflet_curves.freeedge)
crv_5 = Curve(halfleaflet_curves.contact)
crv_6 = Curve(halfleaflet_curves_2.fixededge_2)
crv_7 = Curve(halfleaflet_curves_2.centerline_2)
crv_8 = Curve(halfleaflet_curves_2.interior)
crv_9 = Curve(halfleaflet_curves_2.freeedge)
crv_10 = Curve(halfleaflet_curves_2.contact)
vec2pt_3 = Vector2Pt(PointA=rot3d.Geometry, PointB=rot3d_2.Geometry, Unitize=True)  # -> Vector, Length
surface_generation = SurfaceGeneration(fixededge=crv, freeedge=crv_4, curves=[crv, crv_2, crv_4, crv_3, crv_5])
pdecon_3 = Deconstruct(Point=pt_3)  # -> XComponent, YComponent, ZComponent
pdecon_4 = Deconstruct(Point=pt_5)  # -> XComponent, YComponent, ZComponent
surface_generation_2 = SurfaceGeneration(fixededge=crv_6, freeedge=crv_9, curves=[crv_6, crv_7, crv_9, crv_8, crv_10])
Z_2 = UnitZ(Factor=-1)
pt_7 = Point(vec2pt_3.Vector)
angle_3 = Angle(VectorA=vec2pt_3.Vector, VectorB=Z_2, Plane=PlaneYZ(0, 0, 0))  # -> Angle, Reflex
subtraction = Subtraction(A=pdecon_4.ZComponent, B=pdecon_3.ZComponent)
halfleaflet = Surface(surface_generation)
halfleaflet_2 = Surface(surface_generation_2)
deg_3 = Degrees(Radians=angle_3.Angle)
mirror = Mirror(Geometry=halfleaflet_2, Plane=Plane(origin=(0, 0, 0), x=(0, 0, 1), y=(1, 0, 0)))  # -> Geometry, Transform
mirror_2 = Mirror(Geometry=halfleaflet, Plane=Plane(origin=(0, 0, 0), x=(0, 0, 1), y=(1, 0, 0)))  # -> Geometry, Transform
srf = Surface([halfleaflet, mirror_2.Geometry])
srf_2 = Surface(mirror_2.Geometry)
srf_3 = Surface([halfleaflet_2, mirror.Geometry])
c_script_2 = CSharpScript(obj=flatten(srf), name="Garbage", activate=Toggle(False))  # -> out, trig; inputs obj: GeometryBase, name: String, layer: String, color: Color, pWidth: Double, wires: Int32, activate: Boolean
# ---------- c_script_2: C# ----------
    //Inserts geometry into the Rhino document, with custom attributes
    //Written by Giulio Piacentino edit by Florian Frank (for GH 0.9.0014)
    //Version written 2010 11 21 - for Grasshopper 0.8.002

    if (activate)
    {
      if(obj == null)
      {
        Print("No object to bake");
        return;
      }

      //Make new attribute to set name
      Rhino.DocObjects.ObjectAttributes att = new Rhino.DocObjects.ObjectAttributes();

      //Set object name
      if(!string.IsNullOrEmpty(name))
      {
        att.Name = name;
      }

      //Set color
      if(!color.IsEmpty)
      {
        att.ColorSource = Rhino.DocObjects.ObjectColorSource.ColorFromObject; //Make the color type "by object"
        att.ObjectColor = color;

        att.PlotColorSource = Rhino.DocObjects.ObjectPlotColorSource.PlotColorFromObject; //Make the plot color type "by object"
        att.PlotColor = color;
      }

      //Set layer
      if(!string.IsNullOrEmpty(layer) && Rhino.DocObjects.Layer.IsValidName(layer))
      {
        //Get the current layer index
        Rhino.DocObjects.Tables.LayerTable layerTable = doc.Layers;
        int layerIndex = layerTable.Find(layer, true);

        if(layerIndex < 0) //This layer does not exist, we add it
        {
          Rhino.DocObjects.Layer onlayer = new Rhino.DocObjects.Layer(); //Make a new layer
          onlayer.Name = layer;

          layerIndex = layerTable.Add(onlayer); //Add the layer to the layer table
          if (layerIndex > -1) //We manged to add layer!
          {
            att.LayerIndex = layerIndex;
            Print("Added new layer to the document at position " + layerIndex + " named " + layer + ". ");
          } else
            Print("Layer did not add. Try cleaning up your layers."); //This never happened to me.
        }
        else
          att.LayerIndex = layerIndex; //We simply add to the existing layer
      }


      //Set plotweight
      if(pWidth > 0)
      {
        att.PlotWeightSource = Rhino.DocObjects.ObjectPlotWeightSource.PlotWeightFromObject;
        att.PlotWeight = pWidth;
      }


      //Set material
      bool materialByName = !string.IsNullOrEmpty(material as string);
      Rhino.Display.DisplayMaterial inMaterial = material as Rhino.Display.DisplayMaterial;
      if(material is Color)
      {
        inMaterial = new Rhino.Display.DisplayMaterial((Color) material);
      }
      if(material != null && inMaterial == null && !materialByName)
      {
        if(!(material is string))
        {
          try //We also resort to try with IConvertible
          {
            inMaterial = (Rhino.Display.DisplayMaterial) Convert.ChangeType(material, typeof(Rhino.Display.DisplayMaterial));
          }
          catch(InvalidCastException)
          {
          }
        }
      }
      if(inMaterial != null || materialByName)
      {
        string matName;

        if(!materialByName)
        {
          matName = string.Format("A:{0}-D:{1}-E:{2}-S:{3},{4}-T:{5}",
            Format(inMaterial.Ambient),
            Format(inMaterial.Diffuse),
            Format(inMaterial.Emission),
            Format(inMaterial.Specular),
            inMaterial.Shine.ToString(),
            inMaterial.Transparency.ToString()
            );
        }
        else
        {
          matName = (string) material;
        }

        int materialIndex = doc.Materials.Find(matName, true);
        if(materialIndex < 0 && !materialByName) //Material does not exist and we have its specs
        {
          materialIndex = doc.Materials.Add();
          if(materialIndex > -1)
          {
            Print("Added new material at position " + materialIndex + " named \"" + matName + "\". ");
            Rhino.DocObjects.Material m = doc.Materials[materialIndex];
            m.Name = matName;
            m.AmbientColor = inMaterial.Ambient;
            m.DiffuseColor = inMaterial.Diffuse;
            m.EmissionColor = inMaterial.Emission;
            //m.ReflectionColor = no equivalent
            m.SpecularColor = inMaterial.Specular;
            m.Shine = inMaterial.Shine;
            m.Transparency = inMaterial.Transparency;
            //m.TransparentColor = no equivalent
            m.CommitChanges();

            att.MaterialSource = Rhino.DocObjects.ObjectMaterialSource.MaterialFromObject;
            att.MaterialIndex = materialIndex;
          }
          else
            Print("Material did not add. Try cleaning up your materials."); //This never happened to me.
        }
        else if(materialIndex < 0 && materialByName) //Material does not exist and we do not have its specs. We do nothing
        {
          Print("Warning: material name not found. I cannot set the source to this material name. Add a material with name: " + matName);
        }
        else
        {
          //If this material exists, we do not replace it!
          att.MaterialSource = Rhino.DocObjects.ObjectMaterialSource.MaterialFromObject;
          att.MaterialIndex = materialIndex;
        }
      }


      //Set wire density
      if(wires == -1 || wires > 0)
      {
        att.WireDensity = wires;
      }


      //Bake to the right type of object
      switch(obj.ObjectType)
      {
        case Rhino.DocObjects.ObjectType.Brep:
          doc.Objects.AddBrep(obj as Brep, att);
          break;
        case Rhino.DocObjects.ObjectType.Curve:
          doc.Objects.AddCurve(obj as Curve, att);
          break;
        case Rhino.DocObjects.ObjectType.Point:
          doc.Objects.AddPoint((obj as Rhino.Geometry.Point).Location, att);
          break;
        case Rhino.DocObjects.ObjectType.Surface:
          doc.Objects.AddSurface(obj as Surface, att);
          break;
        case Rhino.DocObjects.ObjectType.Mesh:
          doc.Objects.AddMesh(obj as Mesh, att);
          break;
        case Rhino.DocObjects.ObjectType.Extrusion:
          typeof(Rhino.DocObjects.Tables.ObjectTable).InvokeMember("AddExtrusion", BindingFlags.Instance | BindingFlags.InvokeMethod, null, doc.Objects, new object[]{obj, att});
          break;
        case Rhino.DocObjects.ObjectType.PointSet:
          doc.Objects.AddPointCloud(obj as Rhino.Geometry.PointCloud, att); //This is a speculative entry
          break;
        default:
          Print("The script does not know how to handle this type of geometry: " + obj.GetType().FullName);
          break;
      }
      Print("Added " + obj.GetType().Name);

      trig = true;
    }
    else
    {
      Print("Inactive");
    }
# ---------- c_script_2: C# additional code ----------
  static string Format(Color c)
  {
    return (new System.Text.StringBuilder("A")).Append(c.A.ToString()).Append("R").Append(c.R.ToString()).Append("G")
      .Append(c.G.ToString()).Append("B").Append(c.B.ToString()).ToString();
  }
# ---------- end c_script_2 ----------
c_script_3 = CSharpScript(obj=flatten(srf_3), name="Garbage", activate=Toggle(True))  # -> out, trig; inputs obj: GeometryBase, name: String, layer: String, color: Color, pWidth: Double, wires: Int32, activate: Boolean; same code as c_script_2

# ==== cluster HalfLeafletCurves
freeheightoffset = ClusterInput()
topradius = ClusterInput()
bottom_radius = ClusterInput()
openingradius = ClusterInput()
cornerheight = ClusterInput()
leaflet_gap = Slider(0.0049, range=0..0.01)
commisureangle = ClusterInput()
sinusangle = ClusterInput()
freeangle = ClusterInput()
fixedangle = ClusterInput()
vectors = Vectors(commisureangle=commisureangle, sinusangle=sinusangle, freeangle=freeangle, fixedangle=fixedangle)  # -> freecorner_2, top_2, bottom_2
points = Points(
    bottom_radius=bottom_radius,
    openingradius=openingradius,
    freeheightoffset=freeheightoffset,
    topradius=topradius,
    cornerheight=cornerheight,
    leafletgap=leaflet_gap)  # -> bottompoint_2, toppoint_2, cornerpoint_2
planes = Planes(toppoint=points.toppoint_2, cornerpoint=points.cornerpoint_2, leafletgap=leaflet_gap)  # -> freeedgeplane_2, mirrorplane_2, freecurveplane_2, freecurvepoint
interiorblend = ClusterInput()
fixededgeblend = ClusterInput()
centerlineblend = ClusterInput()
centerlinepoints = CenterlinePoints(
    toptangent=vectors.top_2,
    toppoint=points.toppoint_2,
    blend=centerlineblend,
    bottomtangent=vectors.bottom_2,
    bottompoint=points.bottompoint_2)  # -> toppoint_3, toptangentpoint_2, bottomtangentpoint_2, bottompoint_3
fixededgepoints = FixedEdgePoints(toptangent=vectors.freecorner_2, toppoint=points.cornerpoint_2, blend=fixededgeblend, bottompoint=points.bottompoint_2)  # -> toppoint_3, toptangentpoint_2, bottomtangentpoint_2, bottompoint_3
free_edge = FreeEdge(
    toppoint=points.toppoint_2,
    cornerpoint=points.cornerpoint_2,
    freeedgeplane=planes.freeedgeplane_2,
    mirrorplane=planes.mirrorplane_2,
    freecurveplane=planes.freecurveplane_2,
    freecurvepoint=planes.freecurvepoint)
centerline = NurbsCurve(
    Vertices=flatten([centerlinepoints.toppoint_3, centerlinepoints.toptangentpoint_2, centerlinepoints.bottomtangentpoint_2, centerlinepoints.bottompoint_3]),
    Degree=3,
    Periodic=False)  # -> Curve, Length, Domain
fixededge = NurbsCurve(
    Vertices=flatten([fixededgepoints.toppoint_3, fixededgepoints.toptangentpoint_2, fixededgepoints.bottomtangentpoint_2, fixededgepoints.bottompoint_3]),
    Degree=3,
    Periodic=False)  # -> Curve, Length, Domain
knots = KnotVector(Count=4, Degree=3, Periodic=False)
panel = Panel("""1
3
1.75
1""")
reb = RebuildCurve(Curve=free_edge, Count=20, Tangents=True)
freeedge = ClusterOutput(reb)
nurbcrv = NurbsCurve(
    Points=[fixededgepoints.toppoint_3, fixededgepoints.toptangentpoint_2, fixededgepoints.bottomtangentpoint_2, fixededgepoints.bottompoint_3],
    Weights=panel,
    Knots=knots)  # -> Curve, Length, Domain
flip = FlipCurve(Curve=nurbcrv.Curve)  # -> Curve, Flag
reb_2 = RebuildCurve(Curve=centerline.Curve, Count=20, Tangents=True)
centerline_2 = ClusterOutput(reb_2)
fixededgepoints_2 = FixedEdgePoints_2(freeedge=reb, toptangent=vectors.freecorner_2, toppoint=points.cornerpoint_2, blend=interiorblend, centerline=reb_2)  # -> toppoint_3, toptangentpoint_2, interiortangentpoint_2, interiorpoint_2
reb_3 = RebuildCurve(Curve=flip.Curve, Count=20, Tangents=True)
fixededge_2 = ClusterOutput(reb_3)
knots_2 = KnotVector(Count=4, Degree=3, Periodic=False)
panel_2 = Panel("""1
1.5
1.1
1""")
centerline_3 = NurbsCurve(
    Vertices=flatten([fixededgepoints_2.toppoint_3, fixededgepoints_2.toptangentpoint_2, fixededgepoints_2.interiortangentpoint_2, fixededgepoints_2.interiorpoint_2]),
    Degree=3,
    Periodic=False)  # -> Curve, Length, Domain
nurbcrv_2 = NurbsCurve(
    Points=flatten([fixededgepoints_2.toppoint_3, fixededgepoints_2.toptangentpoint_2, fixededgepoints_2.interiortangentpoint_2, fixededgepoints_2.interiorpoint_2]),
    Weights=panel_2,
    Knots=knots_2)  # -> Curve, Length, Domain
flip_2 = FlipCurve(Curve=nurbcrv_2.Curve)  # -> Curve, Flag
reb_4 = RebuildCurve(Curve=flip_2.Curve, Count=20, Tangents=True)
interior = ClusterOutput(reb_4)
centerlinepoints_2 = CenterlinePoints_2(
    fixededge=reb_3,
    interiorcurve=reb_4,
    freeedge=reb,
    freeangle=freeangle,
    commisureangle=commisureangle,
    sinusangle=sinusangle,
    fixedangle=fixedangle,
    cornerpoint=points.cornerpoint_2)
reb_5 = RebuildCurve(Curve=flatten(centerlinepoints_2), Count=20, Tangents=True)
contact = ClusterOutput(reb_5)

# ==== cluster SurfaceGeneration
curves = ClusterInput()
c_script = CSharpScript(curves=flatten(curves))  # -> halfLeaflet, debug; inputs curves: list of Curve
# ---------- c_script: C# ----------
    int error = 0;
    var nurbsurf = NurbsSurface.CreateNetworkSurface(curves, 2, 0, 0, 0, out error);
    halfLeaflet = nurbsurf;

    debug = error;
# ---------- end c_script ----------
fixededge = ClusterInput()
freeedge = ClusterInput()
ccx = CurveCurve(FixedEdge=fixededge, FreeEdge=freeedge)  # -> Points, ParamsA, ParamsB
rad = Radians(Degrees=-60)
eval_nurb_surf = CSharpScript(
    surfs_in=c_script.halfLeaflet,
    TooltipDescriptionOverride="Saves the relevant information from a given NURBS surface into smesh file format. Also allows user to access all relevant information.",
    TooltipTextOverride="To smesh format")  # -> out, u_degree, v_degree, CtrlNumU, CtrlNumV, KnotU, KnotV, DomainU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; inputs surfs_in: list of Surface
# ---------- eval_nurb_surf: C# ----------
    //if (trigger)
    //{
    //-----------------------------------------------------------------------
    //Delete Old smesh Files
    //-----------------------------------------------------------------------t
    // put all file paths in directory into a string array
    //string[] filePaths = Directory.GetFiles(directory);

    // get the file name (without extension) of each file path
    //for (int i = 0; i < filePaths.Length; i++)
    //{
    //  string fileName = Path.GetFileName(filePaths[i]);

    //  if (fileName.Contains("smesh"))
    //  {
    //    string delFile = string.Format(@"{0}{1}", directory, fileName);
    //    System.IO.File.Delete(delFile);
    //  }
    // }


    //-----------------------------------------------------------------------
    //Build New smesh Files
    //-----------------------------------------------------------------------
    for (int i = 0; i < surfs_in.Count; i++)
    {
      //i = i + 1;

      //convert input surface to NURBS surface
      var nurb_surf = surfs_in[i].ToNurbsSurface();

      //get relevant information about NURBS surface
      double u_degree_dum = nurb_surf.Degree(0);
      double v_degree_dum = nurb_surf.Degree(1);
      double CtrlNumU_dum = nurb_surf.Points.CountU;
      double CtrlNumV_dum = nurb_surf.Points.CountV;
      KnotU = nurb_surf.KnotsU;
      KnotV = nurb_surf.KnotsV;

      //create and fill in knot vectors
      double[] knot_u = new double[nurb_surf.KnotsU.Count];
      for (int u = 0; u < nurb_surf.KnotsU.Count; u++)
        knot_u[u] = nurb_surf.KnotsU[u];
      double[] knot_v = new double[nurb_surf.KnotsV.Count];
      for (int v = 0; v < nurb_surf.KnotsV.Count; v++)
        knot_v[v] = nurb_surf.KnotsV[v];

      //loop to get control points and weights
      var CtrlPts_dum = new ControlPoint[nurb_surf.Points.CountU, nurb_surf.Points.CountV];
      List<Point3d> CtrlPtsList = new List<Point3d>();

      var Weight_dum = new double[nurb_surf.Points.CountU, nurb_surf.Points.CountV];

      for (int u = 0; u < nurb_surf.Points.CountU; u++)
      {
        for (int v = 0; v < nurb_surf.Points.CountV; v++)
        {
          CtrlPts_dum[u, v] = nurb_surf.Points.GetControlPoint(u, v);
          //Print(Convert.ToString(nurb_surf.Points.GetControlPoint(u, v)));
          Weight_dum[u, v] = CtrlPts_dum[u, v].Weight;
        }
      }

      //Get locations of control points and add to Point3d list
      for (int u = 0; u < nurb_surf.Points.CountU; u++)
      {
        for (int v = 0; v < nurb_surf.Points.CountV; v++)
        {

          CtrlPtsList.Add(new Point3d(CtrlPts_dum[u, v].Location.X, CtrlPts_dum[u, v].Location.Y,
            CtrlPts_dum[u, v].Location.Z));
          //sw.WriteLine("{0} {1} {2} {3}", CtrlPts_dum[u, v].Location.X, CtrlPts_dum[u, v].Location.Y,
          //CtrlPts_dum[u, v].Location.Z, CtrlPts_dum[u, v].Weight);
        }
      }

      //assign dummy variables to output variables
      u_degree = u_degree_dum;
      v_degree = v_degree_dum;
      CtrlNumU = CtrlNumU_dum;
      CtrlNumV = CtrlNumV_dum;
      CtrlPts = CtrlPtsList;
      Weight = Weight_dum;
      DomainU = nurb_surf.Domain(0);
      DomainV = nurb_surf.Domain(1);
      //Print(Convert.ToString(nurb_surf.Domain(0)));

      //write to file
      //string path = string.Format("{0}smesh.{1}.dat", directory, Convert.ToString(i));

      /*if (trigger)
      {
      using (StreamWriter sw = new StreamWriter(path))
      {
      //number of spatial dimensions
      sw.WriteLine("3");
      //degree of surface in u and v directions
      sw.WriteLine("{0} {1}", u_degree_dum, v_degree_dum);
      //control points in u and v directions
      sw.WriteLine("{0} {1}", CtrlNumU_dum, CtrlNumV_dum);

      //knot vectors in u and v directions
      sw.Write("{0} ", knot_u[0]);
      for (int u = 0; u < nurb_surf.KnotsU.Count; u++)
      sw.Write("{0} ", knot_u[u]);
      sw.Write("{0} ", knot_u[nurb_surf.KnotsU.Count - 1]);
      sw.Write("\n");
      sw.Write("{0} ", knot_v[0]);
      for (int v = 0; v < nurb_surf.KnotsV.Count; v++)
      sw.Write("{0} ", knot_v[v]);
      sw.Write("{0} ", knot_v[nurb_surf.KnotsV.Count - 1]);
      sw.Write("\n");

      //coordinates of control points and their weight
      for (int v = 0; v < nurb_surf.Points.CountV; v++)
      {
      for (int u = 0; u < nurb_surf.Points.CountU; u++)
      {
      sw.WriteLine("{0} {1} {2} {3}", CtrlPts_dum[u, v].Location.X, CtrlPts_dum[u, v].Location.Y,
      CtrlPts_dum[u, v].Location.Z, CtrlPts_dum[u, v].Weight);
      }
      }

      trig = true;

      }
      }*/
    }
    //}
# ---------- end eval_nurb_surf ----------
rot3d = Rotate3D(Geometry=ccx.Points, Angle=rad, Center=Point(0, 0, 0), Axis=Vector(0, 0, 1))  # -> Geometry, Transform
pdecon = Deconstruct(Point=rot3d.Geometry)  # -> XComponent, YComponent, ZComponent
planesrf = PlaneSurface(Plane=Plane(origin=(0, 0, 0), x=(0, 0, 1), y=(1, 0, 0)), XSize=Domain(0, 2), YSize=Domain(0, 2))
Y = UnitY(Factor=pdecon.YComponent)
move = Move(Geometry=planesrf, Motion=Y)  # -> Geometry, Transform
rad_2 = Radians(Degrees=60)
rot3d_2 = Rotate3D(Geometry=move.Geometry, Angle=rad_2, Center=Point(0, 0, 0), Axis=Vector(0, 0, 1))  # -> Geometry, Transform
cp = PlaneClosestPoint(Point=eval_nurb_surf.CtrlPts, Plane=rot3d_2.Geometry)  # -> Point, UVPoint, Distance
subtraction = Subtraction(A=eval_nurb_surf.CtrlPts, B=cp.Point)
pdecon_2 = Deconstruct(Point=subtraction)  # -> XComponent, YComponent, ZComponent
expression = Expression(x=pdecon_2.XComponent, A=eval_nurb_surf.CtrlPts, B=cp.Point, Expression="If(x>0,A,B)")
c_script_2 = CSharpScript(
    u_degree=eval_nurb_surf.u_degree,
    v_degree=eval_nurb_surf.v_degree,
    CtrlNumU=eval_nurb_surf.CtrlNumU,
    CtrlNumV=eval_nurb_surf.CtrlNumV,
    KnotU=eval_nurb_surf.KnotU,
    KnotV=eval_nurb_surf.KnotV,
    Weight=eval_nurb_surf.Weight,
    CtrlPts=expression)  # -> out, result; inputs u_degree: Int32, v_degree: Int32, CtrlNumU: Int32, CtrlNumV: Int32, KnotU: list of Double, KnotV: list of Double, CtrlPts: list of Point3d
# ---------- c_script_2: C# ----------
    // code adapted from http://wiki.mcneel.com/developer/rhinocommonsamples/createsurfaceexample
    // creates NURBS surface given traditional input parameters

    const bool isRational = false;
    int numberOfDimensions = 3;
    int uDegree = u_degree;
    int vDegree = v_degree;
    int uControlPointCount = CtrlNumU;
    int vControlPointCount = CtrlNumV;

    // The knot vectors do NOT have the 2 superfluous knots
    // at the start and end of the knot vector.  If you are
    // coming from a system that has the 2 superfluous knots,
    // just ignore them when creating NURBS surfaces.
    //var uKnots = new double[uControlPointCount + uDegree - 1];
    //var vKnots = new double[vControlPointCount + vDegree - 1];

    // make up a quadratic knot vector with no interior knots
    //uKnots[0] = uKnots[1] = 0.0;
    //uKnots[2] = uKnots[3] = 1.0;
    double[] uKnots = KnotU.ToArray();
    double[] vKnots = KnotV.ToArray();
    //Print(Convert.ToString(uKnots[1]));

    // make up a cubic knot vector with one simple interior knot
    //vKnots[0] = vKnots[1] = vKnots[2] = 0.0;
    //vKnots[3] = 1.5;
    //vKnots[4] = vKnots[5] = vKnots[6] = 2.0;

    // Rational control points can be in either homogeneous
    // or euclidean form. Non-rational control points do not
    // need to specify a weight.
    var controlPoints = new Point3d[uControlPointCount, vControlPointCount];

    // count up for each point since control points are in a list
    int i = 0;
    for (int u = 0; u < uControlPointCount; u++)
    {
      for (int v = 0; v < vControlPointCount; v++)
      {
        controlPoints[u, v] = CtrlPts[i];
        i = i + 1;
      }
    }

    // creates internal uninitialized arrays for
    // control points and knots
    var nurbsSurface = NurbsSurface.Create(
      numberOfDimensions,
      isRational,
      uDegree + 1,
      vDegree + 1,
      uControlPointCount,
      vControlPointCount
      );

    // add the knots
    for (int u = 0;  u < nurbsSurface.KnotsU.Count; u++)
      nurbsSurface.KnotsU[u] = uKnots[u];
    for (int v = 0; v < nurbsSurface.KnotsV.Count; v++)
      nurbsSurface.KnotsV[v] = vKnots[v];

    // add the control points
    for (int u = 0; u < nurbsSurface.Points.CountU; u++)
    {
      for (int v = 0; v < nurbsSurface.Points.CountV; v++)
      {
        nurbsSurface.Points.SetControlPoint(u, v, controlPoints[u, v]);
      }
    }

    result = nurbsSurface;
# ---------- end c_script_2 ----------
item = ListItem(List=c_script_2.result, Index=0, Wrap=True)
halfleaflet = Surface(item)
halfleaflet_2 = ClusterOutput(halfleaflet)

# ==== cluster Vectors: Generate Leaflet Construction Vectors
commisureangle = ClusterInput()
freeangle = ClusterInput()
fixedangle = ClusterInput()
Z = UnitZ(Factor=1)
neg = Negative(Value=commisureangle)
X = UnitX(Factor=1)
sinusangle = ClusterInput()
Z_2 = UnitZ(Factor=1)
neg_2 = Negative(Value=freeangle)
rad = Radians(Degrees=neg)
X_2 = UnitX(Factor=1)
neg_3 = Negative(Value=Z)
rad_2 = Radians(Degrees=fixedangle)
Y = UnitY(Factor=1)
neg_4 = Negative(Value=X)
rad_3 = Radians(Degrees=neg_2)
Y_2 = UnitY(Factor=1)
neg_5 = Negative(Value=Z_2)
commisureangle_2 = Rotate(Vector=neg_3, Axis=X_2, Angle=rad)
fixedangle_2 = Rotate(Vector=neg_4, Axis=Y, Angle=rad_2)
neg_6 = Negative(Value=sinusangle)
freeangle_2 = Rotate(Vector=neg_5, Axis=Y_2, Angle=rad_3)
rad_4 = Radians(Degrees=neg_6)
Y_3 = UnitY(Factor=1)
bottom = Vector(fixedangle_2)
top = Vector(freeangle_2)
sinusangle_2 = Rotate(Vector=commisureangle_2, Axis=Y_3, Angle=rad_4)
bottom_2 = ClusterOutput(bottom)
top_2 = ClusterOutput(top)
rad_5 = Radians(Degrees=60)
Z_3 = UnitZ(Factor=1)
rotationprojection = Rotate(Vector=sinusangle_2, Axis=Z_3, Angle=rad_5)
freecorner = Vector(rotationprojection)
freecorner_2 = ClusterOutput(freecorner)

# ==== cluster Points: Generate Leaflet Construction Points
cornerheight = ClusterInput()
leafletgap = ClusterInput()
cornerheight_2 = Number(cornerheight)
freeheightoffset = ClusterInput()
neg = Negative(LeafletGap=leafletgap)
topradius = ClusterInput()
bottom_radius = ClusterInput()
pt = ConstructPoint(XCoordinate=topradius, YCoordinate=neg, ZCoordinate=cornerheight_2)
openingradius = ClusterInput()
addition = Addition(A=cornerheight_2, B=freeheightoffset)
pt_2 = ConstructPoint(BottomRadius=bottom_radius, YCoordinate=0, ZCoordinate=0)
pt_3 = ConstructPoint(OpeningRadius=openingradius, YCoordinate=0, ZCoordinate=addition)
rad = Radians(Degrees=60)
bottompoint = Point(pt_2)
rot3d = Rotate3D(Geometry=pt, Angle=rad, Center=Point(0, 0, 0), Axis=Vector(0, 0, 1))  # -> Geometry, Transform
toppoint = Point(pt_3)
bottompoint_2 = ClusterOutput(bottompoint)
cornerpoint = Point(rot3d.Geometry)
toppoint_2 = ClusterOutput(toppoint)
cornerpoint_2 = ClusterOutput(cornerpoint)

# ==== cluster Planes: Generate Leaflet Construction Planes
leafletgap = ClusterInput()
toppoint = ClusterInput()
cornerpoint = ClusterInput()
neg = Negative(LeafletGap=leafletgap)
cornerpoint_2 = Point(cornerpoint)
toppoint_2 = Point(toppoint)
vec = VectorXYZ(XComponent=0, YComponent=neg, ZComponent=0)  # -> Vector, Length
ln = Line(StartPoint="0,0,-5", EndPoint="0,0,5")
move = Move(Geometry=ln, Motion=vec.Vector)  # -> Geometry, Transform
rad = Radians(Degrees=60)
planesrf = PlaneSurface(Plane=Plane(origin=(0, 0, 0), x=(0, 0, 1), y=(1, 0, 0)), XSize=Domain(0, 2), YSize=Domain(0, 2))
rot3d = Rotate3D(Geometry=move.Geometry, Angle=rad, Center=Point(0, 0, 0), Axis=Vector(0, 0, 1))  # -> Geometry, Transform
mirror = Mirror(Geometry=cornerpoint_2, Plane=planesrf)  # -> Geometry, Transform
pl_3pt = Plane3Pt(PointA=toppoint_2, PointB=cornerpoint_2, PointC=mirror.Geometry)
pdecon = Deconstruct(Point=toppoint_2)  # -> XComponent, YComponent, ZComponent
mirrorplane = Plane(planesrf)
freeedgeplane = Plane(pl_3pt)
mirrorplane_2 = ClusterOutput(mirrorplane)
plx = LinePlane(Line=rot3d.Geometry, Plane=freeedgeplane)  # -> Point, ParamL, ParamP
freeedgeplane_2 = ClusterOutput(freeedgeplane)
X = UnitX(Factor=pdecon.XComponent)
planesrf_2 = PlaneSurface(Plane=PlaneYZ(0, 0, 0), XSize=Domain(0, 2), YSize=Domain(0, 2))
ln_2 = Line(StartPoint=plx.Point, EndPoint=cornerpoint_2)
move_2 = Move(Geometry=planesrf_2, Motion=X)  # -> Geometry, Transform
plx_2 = LinePlane(Line=ln_2, Plane=move_2.Geometry)  # -> Point, ParamL, ParamP
ln_3 = Line(StartPoint=toppoint_2, EndPoint=plx_2.Point)
ln_4 = Line(StartPoint=cornerpoint_2, EndPoint=plx_2.Point)
vec2pt = Vector2Pt(PointA=plx_2.Point, PointB=cornerpoint_2, Unitize=True)  # -> Vector, Length
len = Length(Curve=ln_3)
multiplication = Multiplication(A=vec2pt.Vector, B=len)
move_3 = Move(Geometry=plx_2.Point, Motion=multiplication)  # -> Geometry, Transform
crv_cp = CurveClosestPoint(Point=move_3.Geometry, Curve=ln_4)  # -> Point, Parameter, Distance
pframe = PerpFrame(Curve=ln_4, Parameter=crv_cp.Parameter)
freecurveplane = Plane(pframe)
freecurvepoint = ClusterOutput(move_3.Geometry)
freecurveplane_2 = ClusterOutput(freecurveplane)

# ==== cluster FreeEdge: Generates Free Edge of Leaflet
freeedgeplane = ClusterInput()
mirrorplane = ClusterInput()
freecurveplane = ClusterInput()
freecurveplane_2 = Plane(freecurveplane)
freeedgeplane_2 = Plane(freeedgeplane)
mirrorplane_2 = Plane(mirrorplane)
toppoint = ClusterInput()
freecurvepoint = ClusterInput()
_3px = PlanePlanePlane(PlaneA=freeedgeplane_2, PlaneB=mirrorplane_2, PlaneC=freecurveplane_2)  # -> Point, LineAB, LineAC, LineBC
toppoint_2 = Point(toppoint)
freecurvepoint_2 = Point(freecurvepoint)
deplane = DeconstructPlane(Plane=freeedgeplane_2)  # -> Origin, XAxis, YAxis, ZAxis
filletcenterpoint = Point(_3px.Point)
rot3d = Rotate3D(Geometry=toppoint_2, Angle=0.01, Center=filletcenterpoint, Axis=deplane.ZAxis)  # -> Geometry, Transform
cornerpoint = ClusterInput()
arc = Arc3Pt(PointA=toppoint_2, PointB=rot3d.Geometry, PointC=freecurvepoint_2)  # -> Arc, Plane, Radius
ln = Line(StartPoint=cornerpoint, EndPoint=freecurvepoint_2)
join = JoinCurves(Curves=[arc.Arc, ln], Preserve=False)  # -> flatten(Curves)
reb = RebuildCurve(Curve=join, Degree=3, Count=50, Tangents=True)
freeedge = Curve(reb)
freeedge_2 = ClusterOutput(freeedge)

# ==== cluster CenterlinePoints
toppoint = ClusterInput()
blend = ClusterInput()
bottomtangent = ClusterInput()
bottompoint = ClusterInput()
toptangent = ClusterInput()
bottomtangent_2 = Vector(bottomtangent)
bottompoint_2 = Point(bottompoint)
toptangent_2 = Vector(toptangent)
toppoint_2 = Point(toppoint)
blend_2 = Number(blend)
toppoint_3 = ClusterOutput(toppoint_2)
bottompoint_3 = ClusterOutput(bottompoint_2)
ln = Line(StartPoint=toppoint_2, EndPoint=bottompoint_2)
minimum_translate = Slider(0.2, range=0..0.4)
len = Length(Curve=ln)
len_2 = Length(Curve=ln)
subtraction = Subtraction(A=1, B=blend_2)
subtraction_2 = Subtraction(A=len, B=minimum_translate)
multiplication = Multiplication(A=subtraction_2, B=subtraction)
subtraction_3 = Subtraction(A=len_2, B=minimum_translate)
addition = Addition(A=multiplication, B=minimum_translate)
multiplication_2 = Multiplication(A=subtraction_3, B=blend_2)
multiplication_3 = Multiplication(A=toptangent_2, B=addition)
translate_scaling = Slider(0.55, range=0.01..2)
addition_2 = Addition(A=minimum_translate, B=multiplication_2)
multiplication_4 = Multiplication(A=bottomtangent_2, B=addition_2)
multiplication_5 = Multiplication(A=multiplication_3, B=translate_scaling)
multiplication_6 = Multiplication(A=multiplication_4, B=translate_scaling)
move = Move(Geometry=toppoint_2, Motion=multiplication_5)  # -> Geometry, Transform
move_2 = Move(Geometry=bottompoint_2, Motion=multiplication_6)  # -> Geometry, Transform
bottomtangentpoint = Point(move_2.Geometry)
toptangentpoint = Point(move.Geometry)
bottomtangentpoint_2 = ClusterOutput(bottomtangentpoint)
toptangentpoint_2 = ClusterOutput(toptangentpoint)

# ==== cluster FixedEdgePoints
bottompoint = ClusterInput()
toptangent = ClusterInput()
Y = UnitY(Factor=1)
toppoint = ClusterInput()
blend = ClusterInput()
interiortangent = Vector(Y)
bottompoint_2 = Point(bottompoint)
toptangent_2 = Vector(toptangent)
toppoint_2 = Point(toppoint)
blend_2 = Number(blend)
bottompoint_3 = ClusterOutput(bottompoint_2)
toppoint_3 = ClusterOutput(toppoint_2)
ln = Line(StartPoint=toppoint_2, EndPoint=bottompoint_2)
minimum_translate = Slider(0.05, range=0..0.4)
len = Length(Curve=ln)
len_2 = Length(Curve=ln)
subtraction = Subtraction(A=1, B=blend_2)
subtraction_2 = Subtraction(A=len, B=minimum_translate)
multiplication = Multiplication(A=subtraction_2, B=subtraction)
subtraction_3 = Subtraction(A=len_2, B=minimum_translate)
addition = Addition(A=multiplication, B=minimum_translate)
multiplication_2 = Multiplication(A=subtraction_3, B=blend_2)
multiplication_3 = Multiplication(A=toptangent_2, B=addition)
top_scaling = Slider(1.1, range=1..3)
translate_scaling = Slider(0.85, range=0.01..2)
addition_2 = Addition(A=minimum_translate, B=multiplication_2)
multiplication_4 = Multiplication(A=interiortangent, B=addition_2)
multiplication_5 = Multiplication(A=multiplication_4, B=translate_scaling)
multiplication_6 = Multiplication(A=multiplication_3, B=translate_scaling)
multiplication_7 = Multiplication(A=top_scaling, B=multiplication_6)
move = Move(Geometry=bottompoint_2, Motion=multiplication_5)  # -> Geometry, Transform
move_2 = Move(Geometry=toppoint_2, Motion=multiplication_7)  # -> Geometry, Transform
bottomtangentpoint = Point(move.Geometry)
toptangentpoint = Point(move_2.Geometry)
bottomtangentpoint_2 = ClusterOutput(bottomtangentpoint)
toptangentpoint_2 = ClusterOutput(toptangentpoint)

# ==== cluster FixedEdgePoints_2
freeedge = ClusterInput()
toppoint = ClusterInput()
centerline = ClusterInput()
freeedge_2 = Curve(freeedge)
toppoint_2 = Point(toppoint)
divide = DivideCurve(Curve=centerline, Count=2, Kinks=False)  # -> Points, Tangents, Parameters
toppoint_3 = ClusterOutput(toppoint_2)
Y = UnitY(Factor=1)
blend = ClusterInput()
crv_cp = CurveClosestPoint(Point=toppoint_2, Curve=freeedge_2)  # -> Point, Parameter, Distance
item = ListItem(List=divide.Points, Index=1, Wrap=True)
interiortangent = Vector(Y)
interiorpoint = Point(item)
blend_2 = Number(blend)
toptangent = ClusterInput()
eval = EvaluateCurve(Curve=freeedge_2, Parameter=crv_cp.Parameter)  # -> Point, Tangent, Angle
interiorpoint_2 = ClusterOutput(interiorpoint)
toptangent_2 = Vector(toptangent)
neg = Negative(Value=eval.Tangent)
addition = Addition(A=neg, B=toptangent_2)
unit = UnitVector(Vector=addition)
toptangent_3 = Vector(unit)
ln = Line(StartPoint=toppoint_2, EndPoint=interiorpoint)
minimum_translate = Slider(0.4, range=0..0.4)
len = Length(Curve=ln)
len_2 = Length(Curve=ln)
subtraction = Subtraction(A=1, B=blend_2)
subtraction_2 = Subtraction(A=len, B=minimum_translate)
multiplication = Multiplication(A=subtraction_2, B=subtraction)
subtraction_3 = Subtraction(A=len_2, B=minimum_translate)
addition_2 = Addition(A=multiplication, B=minimum_translate)
multiplication_2 = Multiplication(A=subtraction_3, B=blend_2)
multiplication_3 = Multiplication(A=toptangent_3, B=addition_2)
translate_scaling = Slider(0.7, range=0.01..2)
addition_3 = Addition(A=minimum_translate, B=multiplication_2)
multiplication_4 = Multiplication(A=interiortangent, B=addition_3)
multiplication_5 = Multiplication(A=multiplication_3, B=translate_scaling)
multiplication_6 = Multiplication(A=multiplication_4, B=translate_scaling)
move = Move(Geometry=toppoint_2, Motion=multiplication_5)  # -> Geometry, Transform
move_2 = Move(Geometry=interiorpoint, Motion=multiplication_6)  # -> Geometry, Transform
interiortangentpoint = Point(move_2.Geometry)
toptangentpoint = Point(move.Geometry)
interiortangentpoint_2 = ClusterOutput(interiortangentpoint)
toptangentpoint_2 = ClusterOutput(toptangentpoint)

# ==== cluster CenterlinePoints_2
fixededge = ClusterInput()
interiorcurve = ClusterInput()
freeedge = ClusterInput()
freeangle = ClusterInput()
commisureangle = ClusterInput()
fixedangle = ClusterInput()
crv = Curve(freeedge)
divide = DivideCurve(Curve=fixededge, Count=2, Kinks=False)  # -> Points, Tangents, Parameters
divide_2 = DivideCurve(Curve=interiorcurve, Count=2, Kinks=False)  # -> Points, Tangents, Parameters
divide_3 = DivideCurve(Curve=freeedge, Count=2, Kinks=False)  # -> Points, Tangents, Parameters
cornerpoint = ClusterInput()
addition = Addition(A=freeangle, B=commisureangle)
item = ListItem(List=divide.Points, Index=1, Wrap=True)
item_2 = ListItem(List=divide_2.Points, Index=1, Wrap=True)
item_3 = ListItem(List=divide_3.Points, Index=1, Wrap=True)
division = Division(A=addition, B=-2)
intersectpoint = Point(item_2)
fixedpoint = Point(item_3)
freepoint = Point(item)
crv_cp = CurveClosestPoint(Point=cornerpoint, Curve=freeedge)  # -> Point, Parameter, Distance
rad = Radians(Degrees=division)
Z = UnitZ(Factor=-1)
Y = UnitY(Factor=1)
sinusangle = ClusterInput()
item_4 = ListItem(List=divide_3.Parameters, Index=1, Wrap=True)
rot3d = Rotate3D(Geometry=Z, Angle=rad, Center=Point(0, 0, 0), Axis=Y)  # -> Geometry, Transform
vec = Vector(rot3d.Geometry)
pframe = PerpFrame(Curve=freeedge, Parameter=crv_cp.Parameter)
pl_3pt = Plane3Pt(PointA=freepoint, PointB=intersectpoint, PointC=fixedpoint)
division_2 = Division(A=sinusangle, B=2)
pt = Point([fixedpoint, intersectpoint, freepoint])
pframe_2 = PerpFrame(Curve=freeedge, Parameter=item_4)
deplane = DeconstructPlane(Plane=pframe)  # -> Origin, XAxis, YAxis, ZAxis
rad_2 = Radians(Degrees=-60)
deplane_2 = DeconstructPlane(Plane=pframe_2)  # -> Origin, XAxis, YAxis, ZAxis
rad_3 = Radians(Degrees=division_2)
X = UnitX(Factor=1)
rot3d_2 = Rotate3D(Geometry=deplane.ZAxis, Angle=rad_2, Center=Point(0, 0, 0), Axis=Vector(0, 0, 1))  # -> Geometry, Transform
pdecon = Deconstruct(Point=deplane_2.ZAxis)  # -> XComponent, YComponent, ZComponent
rot3d_3 = Rotate3D(Geometry=vec, Angle=rad_3, Center=Point(0, 0, 0), Axis=X)  # -> Geometry, Transform
pt_2 = ConstructPoint(XCoordinate=pdecon.XComponent, YCoordinate=pdecon.YComponent, ZCoordinate=0)
X_2 = UnitX(Factor=1)
rad_4 = Radians(Degrees=-90)
vec_2 = Vector(rot3d_3.Geometry)
pt_3 = Point(rot3d_3.Geometry)
angle = Angle(VectorA=rot3d_2.Geometry, VectorB=X_2, Plane=Plane(origin=(0, 0, 0), x=(0, 0, 1), y=(1, 0, 0)))  # -> Angle, Reflex
rot3d_4 = Rotate3D(Geometry=pt_2, Angle=rad_4, Center=Point(0, 0, 0), Axis=Vector(0, 0, 1))  # -> Geometry, Transform
deg = Degrees(Radians=angle.Angle)
X_3 = UnitX(Factor=1)
neg = Negative(Value=deg)
addition_2 = Addition(A=fixedangle, B=neg)
angle_2 = Angle(VectorA=rot3d_4.Geometry, VectorB=X_3)  # -> Angle, Reflex
deg_2 = Degrees(Radians=angle_2.Angle)
division_3 = Division(A=addition_2, B=2)
rad_5 = Radians(Degrees=deg_2)
rad_6 = Radians(Degrees=division_3)
X_4 = UnitX(Factor=1)
Y_2 = UnitY(Factor=1)
neg_2 = Negative(Value=rad_5)
rot3d_5 = Rotate3D(Geometry=X_4, Angle=rad_6, Center=Point(0, 0, 0), Axis=Y_2)  # -> Geometry, Transform
rot3d_6 = Rotate3D(Geometry=vec_2, Angle=neg_2, Center=Point(0, 0, 0), Axis=Vector(0, 0, 1))  # -> Geometry, Transform
neg_3 = Negative(Value=rot3d_6.Geometry)
intcrv_t = InterpolateT(Vertices=flatten(pt), Degree=3, TangentStart=rot3d_6.Geometry, TangentEnd=Vector(0, 0, 0), KnotStyle=1)  # -> Curve, Length, Domain
contactcurve = ClusterOutput(intcrv_t.Curve)
